# Grasshopper definition 01basicSyntax.gh (Grasshopper 1.0.7)
# plug-ins: Bifocals

number_slider = Slider(6, range=0..10)
ghpython_script = GhPythonScript(x=Slider(10, range=0..10))  # -> out, a, b, c; inputs x: Int32
# ---------- ghpython_script: Python ----------
#a = x
#b = y
#c = a * b + 5

#a = x
#b = list(range(a))
#
#for i in b:
#    print(i ** 2)

#mylist = [4, 6, 9, 10, 15]
#print(mylist)
#print(len(mylist))
#
#for i in range(len(mylist)):
#    print(i)

mylist = []
#print(mylist)
mylist.extend([5,6,7,8,9,10,11,12,13])
#print(mylist)
#
#a = mylist[0]
#b = mylist[1]
c = []

for i in mylist:
    if i < 10:
        c.append(i)
        
print(c)
# ---------- end ghpython_script ----------
panel = Panel(ghpython_script.out)
panel_2 = Panel([ghpython_script.out, ghpython_script.c])
