# Grasshopper definition Function1D.gh (Grasshopper 1.0.7)
# plug-ins: Bifocals

number_slider = Slider(3.194605, range=-360..360)
ghpython_script = GhPythonScript(
    min=Slider(-100, range=-100..100),
    max=Slider(100, range=-100..100),
    scale=Slider(0.02, range=0..5),
    a=Slider(8, range=0..10),
    b=Slider(0, range=-100..100))  # -> out, a
# ---------- ghpython_script: Python ----------
import rhinoscriptsyntax as rs
import math

pts = []

for i in range(int(min), int(max)):
    x = i * scale
#    y = x * a
    y = math.pow(x, a) + b                    # degree
    z = 0
    
    p = rs.AddPoint(x,y,z)
    pts.append(p)
    
a = pts
# ---------- end ghpython_script ----------
ghpython_script_2 = GhPythonScript(min=Slider(0, range=0..100), max=Slider(500, range=-100..500), scale=Slider(0.02, range=0..5), a=Slider(8, range=0..10))  # -> out, a
# ---------- ghpython_script_2: Python ----------
import rhinoscriptsyntax as rs
import math

pts = []

for i in range(int(min), int(max)):
    x = i * scale
    y = math.sqrt(x)
    z = 0
    
    p = rs.AddPoint(x,y,z)
    pts.append(p)
    
a = pts
# ---------- end ghpython_script_2 ----------
ghpython_script_3 = GhPythonScript(
    min=Slider(-100, range=-500..100),
    max=Slider(100, range=-100..500),
    scale=Slider(0.08, range=0..5),
    a=Slider(8.06, range=0..10))  # -> out, a
# ---------- ghpython_script_3: Python ----------
import rhinoscriptsyntax as rs
import math

pts = []

for i in range(int(min), int(max)):
    x = i * scale
    y = math.sqrt(math.pow(a, 2) - math.pow(x, 2))
    z = 0
    
    p = rs.AddPoint(x,y,z)
    pts.append(p)
    
a = pts
# ---------- end ghpython_script_3 ----------
ghpython_script_4 = GhPythonScript(min=Slider(-500, range=-500..100), max=Slider(500, range=-100..500), scale=Slider(0, range=0..5))  # -> out, a
# ---------- ghpython_script_4: Python ----------
import rhinoscriptsyntax as rs
import math

pts = []

for i in range(int(min), int(max)):
    x = i * scale
    y = math.fabs(x)
    z = 0
    
    p = rs.AddPoint(x,y,z)
    pts.append(p)
    
a = pts
# ---------- end ghpython_script_4 ----------
ghpython_script_5 = GhPythonScript(
    min=Slider(-500, range=-500..100),
    max=Slider(500, range=-100..500),
    scale=Slider(0.051, range=0..5),
    a=Slider(-22.79, range=-100..100),
    b=Slider(0, range=-100..100),
    c=Slider(0.5, range=-10..10),
    d=Slider(-0.31, range=-10..10))  # -> out, a
# ---------- ghpython_script_5: Python ----------
import rhinoscriptsyntax as rs
import math

pts = []

for i in range(int(min), int(max)):
    x = i * scale
    y = math.cos(x * c+d) * a + b
    z = 0
    
    p = rs.AddPoint(x,y,z)
    pts.append(p)
    
a = pts
# ---------- end ghpython_script_5 ----------
ghpython_script_6 = GhPythonScript(
    min=Slider(-500, range=-500..100),
    max=Slider(500, range=-100..500),
    scale=Slider(0.02, range=0..5),
    a=Slider(-2.91, range=-100..100),
    b=Slider(0, range=-100..100),
    c=Slider(2, range=-10..10),
    d=Slider(0, range=-10..10))  # -> out, a, b, c
# ---------- ghpython_script_6: Python ----------
import rhinoscriptsyntax as rs
import math

pts = []
pts2 = []
pts3 = []

for i in range(int(min), int(max)):
    x = i * scale
    y = math.cos(x * c+d) * a + b
    yy = math.sin(x * c)
    z = 0
    
    p = rs.AddPoint(x,y,z)
    pts.append(p)
    
    p = rs.AddPoint(x,yy,z)
    pts2.append(p)
    
    p = rs.AddPoint(x,y*yy,z)
    pts3.append(p)
    
a = pts
b = pts2
c = pts3
# ---------- end ghpython_script_6 ----------
ghpython_script_7 = GhPythonScript(
    min=Slider(-500, range=-500..100),
    max=Slider(500, range=-100..500),
    scale=Slider(0.02, range=0..5),
    a=Slider(1, range=-100..100),
    c=Slider(1.47, range=-10..10),
    b=Slider(0, range=-100..100),
    d=Slider(1.69, range=-10..10))  # -> out, a, b, c
# ---------- ghpython_script_7: Python ----------
import rhinoscriptsyntax as rs
import math

pts = []

for i in range(int(min), int(max)):
    x = i * scale
    y = math.pow(d, - (a * math.pow(-b + x, 2)))
    y = y*c
    z = 0
    
    p = rs.AddPoint(x,y,z)
    pts.append(p)
    
a = pts
# ---------- end ghpython_script_7 ----------
ghpython_script_8 = GhPythonScript(
    min=Slider(-500, range=-500..100),
    max=Slider(500, range=-100..500),
    scale=Slider(0.02, range=0..5),
    a=Slider(0, range=-100..100),
    c=Slider(0.61, range=-10..10),
    d=Slider(0, range=-10..10))  # -> out, a, b, c
# ---------- ghpython_script_8: Python ----------
import rhinoscriptsyntax as rs
import math

pts = []

for i in range(int(min), int(max)):
    x = i * scale
    y = math.floor(x * c+ d) + a
    z = 0
    
    p = rs.AddPoint(x,y,z)
    pts.append(p)
    
a = pts
# ---------- end ghpython_script_8 ----------
ghpython_script_9 = GhPythonScript(
    min=Slider(-500, range=-500..100),
    max=Slider(500, range=-100..500),
    scale=Slider(0.02, range=0..5),
    a=Slider(-2.91, range=-100..100),
    c=Slider(-2.4, range=-10..10),
    d=Slider(10, range=-10..10))  # -> out, a, b, c
# ---------- ghpython_script_9: Python ----------
import rhinoscriptsyntax as rs
import math

pts = []

for i in range(int(min), int(max)):
    x = i * scale
    y = math.tan(x * c+d)
    z = 0
    
    p = rs.AddPoint(x,y,z)
    pts.append(p)
    
a = pts
# ---------- end ghpython_script_9 ----------
panel = Panel(ghpython_script.a)
panel_2 = Panel(ghpython_script_2.a)
panel_3 = Panel(ghpython_script_3.a)
panel_4 = Panel(ghpython_script_5.a)
panel_5 = Panel(ghpython_script_4.a)
interpolate = Interpolate(Vertices=ghpython_script_6.c, Degree=3, Periodic=False, KnotStyle=1)  # -> Curve, Length, Domain
pipe = Pipe(Curve=interpolate.Curve, Radius=Slider(0.15, range=0..1), Caps=0)
