# Grasshopper definition Length.gh (Grasshopper 1.0.7)

ghpython_script = GhPythonScript()  # -> out, ln0, ln1, cp
# ---------- ghpython_script: Python ----------
import rhinoscriptsyntax as rs

p0 = rs.AddPoint(-5.25, -5, 0)
p1 = rs.AddPoint(5, 3, 0)

ln0 = rs.AddLine(p0, p1)


p0 = rs.AddPoint(-5, 9, 0)
p1 = rs.AddPoint(5, -5.9, 0)

ln1 = rs.AddLine(p0, p1)

cp = rs.LineLineIntersection(ln0, ln1)
# ---------- end ghpython_script ----------
ghpython_script_2 = GhPythonScript()  # -> out, ln0, ln1, cp, dis1, dis2, disOther
# ---------- ghpython_script_2: Python ----------
import rhinoscriptsyntax as rs
import math

p0 = rs.AddPoint(-5.25, -5, 0)
p1 = rs.AddPoint(5, 3, 0)
ln0 = rs.AddLine(p0, p1)
#dis1 = rs.Distance(p0, p1)

p0 = rs.AddPoint(-5.5, 9.02, 0)
p1 = rs.AddPoint(-1, -1, 0)
ln1 = rs.AddLine(p0, p1)
#dis2 = rs.Distance(p0, p1)

cp = rs.LineLineIntersection(ln0, ln1)

p0 = rs.PointCoordinates(p0)
p1 = rs.PointCoordinates(p1)

print(p0)
print(p1)
disOther = math.sqrt(math.pow(p1[0] - p0[0], 2) + math.pow(p1[1] - p0[1], 2) + math.pow(p1[2] - p0[2], 2))
# ---------- end ghpython_script_2 ----------
length = Length(Curve=[ghpython_script_2.ln0, ghpython_script_2.ln1])
panel = Panel([length, ghpython_script_2.disOther])
