# Grasshopper definition Line.gh (Grasshopper 1.0.7)
# plug-ins: Bifocals

ghpython_script = GhPythonScript(min=Slider(-100, range=-100..100), max=Slider(100, range=0..100))  # -> out, a, b
# ---------- ghpython_script: Python ----------
import rhinoscriptsyntax as rs
import random as r

lns = []
pts = []

xrc1, xrc2 = r.randrange(min, max), r.randrange(min, max)
yrc1, yrc2 = r.randrange(min, max), r.randrange(min, max)
zrc1, zrc2 = r.randrange(min, max), r.randrange(min, max)

p0 = rs.AddPoint(xrc1,yrc1,zrc1)
p1 = rs.AddPoint(r.randrange(-100, 100),r.randrange(-100, 100),r.randrange(-100, 100))
p2 = rs.AddPoint(xrc2,yrc2,zrc2)
p3 = rs.AddPoint(0,0,0)

ln1 = rs.AddLine(p0, p1)
ln2 = rs.AddLine(p2, p3)
ln3 = rs.AddLine(p0, p3)
ln4 = rs.AddLine(p1, p2)

lns.append(ln1)
lns.append(ln2)
lns.append(ln3)
lns.append(ln4)

pts.append(p0)
pts.append(p1)
pts.append(p2)
pts.append(p3)

a = lns 
b = pts
# ---------- end ghpython_script ----------
ghpython_script_2 = GhPythonScript()  # -> out, a, b, c, d, e, ln1, ln2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
# ---------- ghpython_script_2: Python ----------
import rhinoscriptsyntax as rs

p0 = rs.AddPoint(0,0,0)
p1 = rs.AddPoint(10,10,10)
refp = rs.AddPoint(10,7,0)

p2 = rs.AddPoint(5,5,0)
p3 = rs.AddPoint(-10,6,13)

a = p0
b = p1
#c = refp
d = p2
e = p3

ln1 = rs.AddLine(p0, p1)
ln2 = rs.AddLine(p2, p3)
ln3 = rs.AddLine(p0, p3)
ln4 = rs.AddLine(p1, p2)
#cp = rs.LineClosestPoint(ln, refp)
# ---------- end ghpython_script_2 ----------
ghpython_script_3 = GhPythonScript(
    seed=Slider(43, range=0..100),
    pNum=Slider(27, range=0..100),
    min=Slider(-100, range=-100..100),
    max=Slider(100, range=0..100))  # -> out, a, b; inputs pNum: Int32
# ---------- ghpython_script_3: Python ----------
import rhinoscriptsyntax as rs
import random as r

r.seed(seed)

pts = []
lns = []

for i in range(pNum):
    p = rs.AddPoint(r.randrange(min, max), r.randrange(min, max), r.randrange(min, max))  
    pts.append(p)
    
for j in range(len(pts)-1):
    ln = rs.AddLine(pts[j], pts[j+1])
    lns.append(ln)

lp0 = rs.PointCoordinates(pts[0])
lp1 = rs.PointCoordinates(pts[len(pts)-1])
lln = rs.AddLine(lp0, lp1)
lns.append(lln)

a = pts
b = lns
l = lln
# ---------- end ghpython_script_3 ----------
panel = Panel(ghpython_script_3.a)
ghpython_script_4 = GhPythonScript()  # -> out, a
# ---------- ghpython_script_4: Python ----------
import rhinoscriptsyntax as rs

pts = []
lns = []

p0 = rs.AddPoint(0,0,0)
p1 = rs.AddPoint(5,5,5)
p2 = rs.AddPoint(10,10,55)
p3 = rs.AddPoint(15,15,15)

pts.append(p0)
pts.append(p1)
pts.append(p2)
pts.append(p3)

for i in range(len(pts)-1):
    ln = rs.AddLine(pts[i], pts[i+1])
    lns.append(ln)
    
a = lns
# ---------- end ghpython_script_4 ----------
