# Grasshopper definition 02pointGridBasic.gh (Grasshopper 1.0.7)
# plug-ins: Bifocals

ghpython_script = GhPythonScript(a=Slider(10, range=0..10), b=Slider(1.092, range=0..10), c=Slider(4.068, range=0..10))  # -> out, a, b, c
# ---------- ghpython_script: Python ----------
import rhinoscriptsyntax as rs

a = rs.AddPoint((a,a,a))
b = rs.AddPoint((b,b,b))
c = rs.AddPoint((c,c,c))
# ---------- end ghpython_script ----------
number_slider = Slider(3, range=0..100)
ghpython_script_2 = GhPythonScript(x=number_slider, y=number_slider)  # -> out, p; inputs x: Int32, y: Int32
# ---------- ghpython_script_2: Python ----------
import rhinoscriptsyntax as rs

p =rs.AddPoint((x,y,0))
# ---------- end ghpython_script_2 ----------
ghpython_script_3 = GhPythonScript(p=ghpython_script_2.p, x=Slider(51, range=0..100))  # -> out, a, b, c; inputs x: Int32
# ---------- ghpython_script_3: Python ----------
import rhinoscriptsyntax as rs

xpl = []
ypl = []
zpl = []
xyzpl = []

refp = rs.PointCoordinates(p)

for i in range(x):
    xp = rs.AddPoint(i,0,0)
    yp = rs.AddPoint(0,i,0)
    zp = rs.AddPoint(0,0,i)
    
    xpl.append(xp)
    ypl.append(yp)
    zpl.append(zp)
    
    dis = rs.Distance(refp, p)
    print(p)

a = xpl
b = ypl
c = zpl

refp = rs.PointCoordinates(p) # reference point

print(type(refp))                # <type'Point3d'>
print(refp[0], type(refp[0]))       # Point3d p[0] == x-coordinate
print(refp[1], type(refp[1]))       # Point3d p[1] == y-coordinate
print(refp[2], type(refp[2]))       # Point3d p[2] == z-coordinate
# ---------- end ghpython_script_3 ----------

ghpython_script_4 = GhPythonScript(x=Slider(21, range=0..100), y=Slider(19, range=0..100), z=Slider(14, range=0..100))  # -> out, p; inputs x: Int32, y: Int32, z: Int32
# ---------- ghpython_script_4: Python ----------
import rhinoscriptsyntax as rs

p = rs.AddPoint((x,y,z))
# ---------- end ghpython_script_4 ----------
ghpython_script_5 = GhPythonScript(p=ghpython_script_4.p, x=Slider(35, range=0..100))  # -> out, pts; inputs x: Int32
# ---------- ghpython_script_5: Python ----------
import rhinoscriptsyntax as rs

pts = []                              # AddPoint를 담을 empty point list
refp = rs.PointCoordinates(p)         # reference point의 좌표값 검색
print(refp[0])                        # x-coordinate
print(refp[1])                        # y-coordinate

for i in range(x+1):
    for j in range(x+1):
        p = rs.AddPoint(i,j,0)
        pts.append(p)
        
        dis = rs.Distance(refp, p)    # point1과 point2간의 distance value return
        rs.MoveObject(p, (0,0,dis))   # rs.Distance()를 통해 얻어낸 값을 통해
                                      # refp와 멀리 있을 수록 z값을 move
# ---------- end ghpython_script_5 ----------
panel = Panel(ghpython_script_5.out)
panel_2 = Panel(ghpython_script_5.pts)

ghpython_script_6 = GhPythonScript(x=Slider(14, range=0..100))  # -> out, pts; inputs x: Int32
# ---------- ghpython_script_6: Python ----------
import rhinoscriptsyntax as rs

pts = []                              # AddPoint를 담을 empty point list

for i in range(x+1):
    for j in range(x+1):
        p = rs.AddPoint(i,j,0)
        pts.append(p)
# ---------- end ghpython_script_6 ----------
panel_3 = Panel(ghpython_script_6.out)
panel_4 = Panel(ghpython_script_6.pts)
