# Grasshopper definition RandomNormalDistribution.gh (Grasshopper 1.0.7)
# plug-ins: Bifocals

number_slider = Slider(1000, range=0..1000)
ghpython_script = GhPythonScript(
    dNum=Slider(5565, range=0..10000),
    gPow=Slider(5.1, range=0..10),
    b=Slider(4.4, range=0..10),
    w=number_slider,
    h=number_slider,
    scale=Slider(34, range=0..100),
    tDis=Slider(4218, range=0..10000),
    pow=Slider(7, range=0..100))  # -> out, a; inputs dNum: Int32
# ---------- ghpython_script: Python ----------
import rhinoscriptsyntax as rs
import random as r
import math

r.seed(0)
pts = []

for i in range(dNum):
    
    epsilon = math.pow(gPow, -math.pow(r.random() * 2, 2) * b)

#    x = (r.random() - 0.5) * int(w) * math.pow(epsilon, pow)
#    y = (r.random() - 0.5) * int(h) * math.pow(epsilon, pow)    
    x = (r.random() - 0.5) * 400 * math.pow(epsilon, pow)
    y = (r.random() - 0.5) * 400 * math.pow(epsilon, pow)
#    z = epsilon * scale
    z = (r.random() - 0.5) * 400 * math.pow(epsilon, pow)
    
    dis = x*x + y*y + z*z
    
    if dis < tDis:      
        p = rs.AddPoint(x,y,z)
        pts.append(p)

a = pts
# ---------- end ghpython_script ----------
