# Grasshopper definition RandomPointCloud.gh (Grasshopper 1.0.7)
# plug-ins: Bifocals

ghpython_script = GhPythonScript(
    pNum=Slider(556, range=0..1000),
    width=Slider(294, range=0..1000),
    length=Slider(111, range=0..1000),
    height=Slider(86, range=0..1000))  # -> out, a; inputs pNum: Int32, width: Int32, length: Int32, height: Int32
# ---------- ghpython_script: Python ----------
import rhinoscriptsyntax as rs
import random


pts = []

for i in range(pNum):
#    x = random.randrange(1, 50)
#    y = random.randrange(1, 50)
    x = (random.random()-0.5) * width
    y = (random.random()-0.5) * length
    z = random.random() * height
    p = rs.AddPoint(x, y, z)
    pts.append(p)
    
a = pts
# ---------- end ghpython_script ----------
