# Grasshopper definition AddLoftSrf02.gh (Grasshopper 1.0.7)
# plug-ins: Bifocals

# ----
# 라인이 그려지는 방향에 따라 offset의 + - 값에 영향
ghpython_script = GhPythonScript()  # -> out, lns
# ---------- ghpython_script: Python ----------
import rhinoscriptsyntax as rs
import Rhino.Geometry as rg

pts = [rs.AddPoint(10 + px*50, 10 +py*50, 0) for px in range(2) for py in range(2)]

lns = []
for ln1 in range(3):
    if ln1 % 2 == 0:
        ln = rs.AddLine(pts[ln1], pts[ln1+1])
        lns.append(ln)

for ln2 in range(2):
    ln = rs.AddLine(pts[ln2], pts[ln2+2])
    lns.append(ln)


lns
# ---------- end ghpython_script ----------
merge = Merge(Data1=ghpython_script.lns)
curve = Curve(merge)
offset_curve = OffsetCurve(Curve=curve, Distance=1, Plane=PlaneXY(0, 0, 0), Corners=1)

ghpython_script_2 = GhPythonScript(offset=Slider(-5, range=-5..5), div_no=Slider(10, range=3..10), l_type=Slider(1, range=1..3))  # -> out, rec1, rec2, dpt1, dpt2, lns, dpt3, loftsrf; inputs div_no: Int32, l_type: Int32
# ---------- ghpython_script_2: Python ----------
import rhinoscriptsyntax as rs
import Rhino.Geometry as rg

ref_rec = rg.Rectangle3d(rg.Plane.WorldXY, 50, 50) # Rhino.Geometry.Rectangle3d
rec1 = rs.MoveObject(ref_rec, [-60,-60,0])         # Move -> GUID value retrun -> 2bde2293-5083-4b80-bafd-276cab19ef87 
rec2 = rs.OffsetCurve(rec1, [0,0,0], offset)

dp1 = []
dp2 = []
dpt1 = rs.DivideCurve(rec1, div_no)     # Geometry object
dpt2 = rs.DivideCurve(rec2, div_no)     # Geometry object
for i in range(div_no):
    dp1.append(rs.AddPoint(dpt1[i]))    # GUID list
    dp2.append(rs.AddPoint(dpt2[i]))    # GUID list

lns = []
for i in range(div_no):
    lns.append(rs.AddLine(dpt1[i], dpt2[i]))

dpt3 = []
for i in range(div_no):
    t = rs.CurveDomain(lns[i])[1] / 2
    p = rs.EvaluateCurve(lns[i], t)
    dpt3.append(rs.AddPoint(p))
    rs.MoveObject(dpt3[i], [0,0,50])

crv = []
for i in range(div_no):
    crv.append(rs.AddLine(dpt2[i], dpt3[i]))

loftsrf = rs.AddLoftSrf(crv, loft_type = l_type, closed=True) # loft_type

print(crv)
# ---------- end ghpython_script_2 ----------

ghpython_script_3 = GhPythonScript(
    offset=Slider(-10.92, range=-15..15),
    div_no=Slider(10, range=3..10),
    l_type=Slider(3, range=1..3),
    z=Slider(217.8, range=0..300))  # -> out, loftsrf; inputs div_no: Int32, l_type: Int32
# ---------- ghpython_script_3: Python ----------
import rhinoscriptsyntax as rs
import Rhino.Geometry as rg

ref_rec = rg.Rectangle3d(rg.Plane.WorldXY, 50, 50) # Rhino.Geometry.Rectangle3d
rec1 = rs.MoveObject(ref_rec, [-60,-60,0])         # Move -> GUID value retrun -> 2bde2293-5083-4b80-bafd-276cab19ef87 
rec2 = rs.OffsetCurve(rec1, [0,0,0], offset)

dp1 = []
dp2 = []
dpt1 = rs.DivideCurve(rec1, div_no)     # Geometry object
dpt2 = rs.DivideCurve(rec2, div_no)     # Geometry object
for i in range(div_no):
    dp1.append(rs.AddPoint(dpt1[i]))    # GUID list
    dp2.append(rs.AddPoint(dpt2[i]))    # GUID list

lns = []
for i in range(div_no):
    lns.append(rs.AddLine(dpt1[i], dpt2[i]))

dpt3 = []
for i in range(div_no):
    t = rs.CurveDomain(lns[i])[1] / 2
    p = rs.EvaluateCurve(lns[i], t)
    dpt3.append(rs.AddPoint(p))
    rs.MoveObject(dpt3[i], [0,0,z])

crv = [] 
for i in range(div_no):
    crv.append(rs.AddLine(dpt2[i], dpt3[i])) # GUID list

loftsrf = rs.AddLoftSrf(crv, loft_type = l_type, closed=True) # loft_type
rs.CapPlanarHoles(loftsrf)
# ---------- end ghpython_script_3 ----------
