# Grasshopper definition AddLoftSrf04.gh (Grasshopper 1.0.7)

ghpython_script = GhPythonScript(seed=Slider(31, range=0..100), z=Slider(96, range=0..100), seg=Slider(20, range=0..20), type=Slider(3, range=1..3))  # -> out, a, b, c, d, e; inputs z: Int32, seg: Int32, type: Int32
# ---------- ghpython_script: Python ----------
import rhinoscriptsyntax as rs
import Rhino.Geometry as rg
import random as r

#r.seed(seed)
c1 = rs.AddCircle(rg.Plane.WorldXY, r.randrange(1, 100))
c2 = rs.AddCircle([0,0,z], r.randrange(1, 100))
c3 = rs.AddCircle([0,0,z*2], r.randrange(1, 100))

c1pts = []
c2pts = []
c3pts = []
c1p = rs.DivideCurve(c1, seg)
c2p = rs.DivideCurve(c2, seg)
c3p = rs.DivideCurve(c3, seg)

for i in range(seg):
    c1pts.append(rs.AddPoint(c1p[i]))
    c2pts.append(rs.AddPoint(c2p[i]))
    c3pts.append(rs.AddPoint(c3p[i]))

lns = []
for l in range(seg):
    lns.append(rs.AddLine(c1pts[l], c2pts[l]))
    lns.append(rs.AddLine(c2pts[l], c3pts[l]))

loft = rs.AddLoftSrf(lns, loft_type = type, closed=True)

print(lns)

#a = c1
#b = c2
#c = c3
d = loft
e = lns
# ---------- end ghpython_script ----------
