# Grasshopper definition AttractorPoint.gh (Grasshopper 1.0.7)

point = Point(Point(-1.355549589, 30.87409507, 58.87175216))
ghpython_script = GhPythonScript(attractor=point, x=Slider(29, range=0..50))  # -> out, a, b; inputs x: Int32
# ---------- ghpython_script: Python ----------
import rhinoscriptsyntax as rs
import Rhino.Geometry as rg
import random as r

all_pts = []
for i in range(10):
    for j in range(10):
        for k in range(30):
            p = rs.AddPoint(i*5,j*5,k*5)
            all_pts.append(p)

dis_pts = []
dis_lns = []
for i in range(len(all_pts)):
    dis = rs.Distance(attractor, all_pts[i])
    if dis >= x:
        dis_pts.append(all_pts[i])
    else:
        dis_lns.append(rs.AddLine(attractor, all_pts[i]))

sph = rs.AddSphere(attractor, dis/4)

a = dis_pts
b = sph
# ---------- end ghpython_script ----------
number_slider = Slider(2, range=0..10)
colour_picker = ColourPicker(PickedColour=RGB(255, 255, 255))
center_box = CenterBox(Base=ghpython_script.a, X=number_slider, Y=number_slider, Z=number_slider)
custom_preview = CustomPreview(Geometry=[center_box, ghpython_script.b], Material=colour_picker)
