# Grasshopper definition BasicTruss.gh (Grasshopper 1.0.7)
# plug-ins: Kangaroo2 Components

ghpython_script = GhPythonScript(xNum=Slider(8, range=0..100), scale=Slider(10, range=0..100))  # -> out, a, b, c; inputs xNum: Int32
# ---------- ghpython_script: Python ----------
import rhinoscriptsyntax as rs
import Rhino

pts = []
lns = []

for i in range(xNum):
    for j in range(2):
        p = rs.AddPoint(i * scale, 0, j*scale)
        p = rs.PointCoordinates(p)
        pts.append(p)

for k in range(xNum * 2 - 1):
    lns.append(rs.AddLine(pts[k], pts[k+1]))

for l in range(xNum * 2 - 2):
    lns.append(rs.AddLine(pts[l], pts[l+2]))


#rs.GetLine(lns)
print(lns[0])


b = lns
# ---------- end ghpython_script ----------
ghpython_script_2 = GhPythonScript(xNum=Slider(8, range=0..100), scale=Slider(10, range=0..100))  # -> out, a, b, c; inputs xNum: Int32
# ---------- ghpython_script_2: Python ----------
import rhinoscriptsyntax as rs
import Rhino

pts = []
lns = []

for i in range(xNum):
    for j in range(2):
        p = rs.AddPoint(i * scale, 30, j*scale)
        p = rs.PointCoordinates(p)
        pts.append(p)

for k in range(xNum * 2 - 1):
    lns.append(rs.AddLine(pts[k], pts[k+1]))

for l in range(xNum * 2 - 2):
    lns.append(rs.AddLine(pts[l], pts[l+2]))


#rs.GetLine(lns)
print(lns[0])


b = lns
# ---------- end ghpython_script_2 ----------
merge = Merge(Data1=ghpython_script.b)
merge_2 = Merge(Data1=ghpython_script_2.b)
curve = Curve(merge)
curve_2 = Curve(merge_2)
multipipe = MultiPipe(Curves=curve, NodeSize=Slider(0.3, range=0..1), EndOffset=1, StrutSize=1, Segment=0, KinkAngle=0.6, CubeFit=0)
pipe = Pipe(Curve=curve_2, Radius=Slider(0.3, range=0..1), Caps="2")
