# Grasshopper definition BasicTruss02.gh (Grasshopper 1.0.7)
# plug-ins: Kangaroo2 Components

ghpython_script = GhPythonScript(pNum=Slider(10, range=0..10), scale=Slider(10, range=0..10), z=Slider(22.31, range=0..50))  # -> out, pts1, pts2, lns1, lns2, lns3; inputs pNum: Int32
# ---------- ghpython_script: Python ----------
import rhinoscriptsyntax as rs

p = rs.AddPoint

pts1 = [rs.PointCoordinates(p(i * scale, 25, z)) for i in range(pNum)]
dis = rs.Distance(pts1[0], pts1[1]) / 2
pts2 = [rs.PointCoordinates(p((i * scale) + dis, 25, z-10)) for i in range(pNum-1)]

lns1 = [rs.AddLine(pts1[p], pts1[p+1]) for p in range(len(pts1)-1)]
lns2 = [rs.AddLine(pts2[p], pts2[p+1]) for p in range(len(pts2)-1)]

lns3 = []
for i in range(len(pts2)):
    lns3.append(rs.AddLine(pts1[i], pts2[i]))
    lns3.append(rs.AddLine(pts1[i+1], pts2[i]))
# ---------- end ghpython_script ----------
ghpython_script_2 = GhPythonScript(pNum=Slider(10, range=0..10), scale=Slider(10, range=0..10), z=Slider(22.31, range=0..50))  # -> out, pts1, pts2, lns1, lns2, lns3; inputs pNum: Int32
# ---------- ghpython_script_2: Python ----------
import rhinoscriptsyntax as rs

p = rs.AddPoint

pts1 = [rs.PointCoordinates(p(i * scale, 0, z)) for i in range(pNum)]
dis = rs.Distance(pts1[0], pts1[1]) / 2
pts2 = [rs.PointCoordinates(p((i * scale) + dis, 0, z-10)) for i in range(pNum-1)]

lns1 = [rs.AddLine(pts1[p], pts1[p+1]) for p in range(len(pts1)-1)]
lns2 = [rs.AddLine(pts2[p], pts2[p+1]) for p in range(len(pts2)-1)]

lns3 = []
for i in range(len(pts2)):
    lns3.append(rs.AddLine(pts1[i], pts2[i]))
    lns3.append(rs.AddLine(pts1[i+1], pts2[i]))
# ---------- end ghpython_script_2 ----------
merge = Merge(Data1=ghpython_script.lns1, Data2=ghpython_script.lns2, Data3=ghpython_script.lns3)
merge_2 = Merge(Data1=ghpython_script_2.lns1, Data2=ghpython_script_2.lns2, Data3=ghpython_script_2.lns3)
multipipe = MultiPipe(Curves=merge_2, NodeSize=Slider(0.3, range=0..1), EndOffset=1, StrutSize=1, Segment=0, KinkAngle=0.6, CubeFit=0)
pipe = Pipe(Curve=merge, Radius=Slider(0.3, range=0..1), Caps="2")
