# Grasshopper definition BasicTruss03.gh (Grasshopper 1.0.7)

ghpython_script = GhPythonScript(pNum=Slider(8, range=0..10), scale=Slider(10, range=0..10), z=Slider(13.28, range=0..50))  # -> out, pts1, pts2, lns1, lns2, lns3; inputs pNum: Int32
# ---------- ghpython_script: Python ----------
import rhinoscriptsyntax as rs

p = rs.AddPoint
pts1 = []
pts2 = []
lns1 = []

for i in range(pNum):
    for j in range(pNum):
        p1 = p(i * scale, j * scale, z)
        p1 = rs.PointCoordinates(p1)
        pts1.append(p1)

dis = rs.Distance(pts1[0], pts1[1]) / 2

for j in range(pNum-1):
    for k in range(pNum-1):
        p2 = p(j * scale + dis, k * scale + dis, z/2)
        p2 = rs.PointCoordinates(p2)
        pts2.append(p2)

for i in range(7):
    if pts1.index(pts1[i]) % pNum != 0:
        ln1 = rs.AddLine(pts1[i],pts2[i])
        ln2 = rs.AddLine(pts1[i+1],pts2[i])
        lns1.append(ln1)
        lns1.append(ln2)
#    elif pts1.index(pts1[i]) % pNum == 0:

# 0 1 = 0
# 1 2 = 1
# 2 3 = 2
# 3 4 = 3
# 4 5 = 4
# 5 6 = 5
# 6 7 = 6

#for i in range(len(pts1)-1):
#    if pts1.index(pts1[i]) % pNum == 0:
#        ln1 = rs.AddLine(pts1[i], pts1[(i+pNum)-1])
#        lns1.append(ln1)
#        print(pts1.index(pts1[i]))

pts1
pts2
lns1
# ---------- end ghpython_script ----------
