# Grasshopper definition CurvedPipe.gh (Grasshopper 1.0.7)

number_slider = Slider(37, range=0..100)
ghpython_script = GhPythonScript(x=number_slider, y=number_slider)  # -> pts, crv, pipe; inputs x: Int32, y: Int32
# ---------- ghpython_script: Python ----------
import rhinoscriptsyntax as rs
import Rhino.Geometry as rg
import random as r

pts = [rs.AddPoint(i*x,j*x,r.randrange(1, 100))\
     for i in range(5) for j in range(5)]

crv = rs.AddCurve(pts, degree=2)

pipe = rs.AddPipe(crv, 0, 1, cap=1)
# ---------- end ghpython_script ----------
