# Grasshopper definition GenerativeForm.gh (Grasshopper 1.0.7)

number_slider = Slider(153, range=0..170)
number_slider_2 = Slider(10, range=0..10)
construct_point = ConstructPoint(XCoordinate=Slider(102, range=0..170), YCoordinate=number_slider, ZCoordinate=Slider(0, range=0..100))
number_slider_3 = Slider(0.354, range=0..1)
taper = Slider(6, range=1..6)
rectangle = Rectangle(Plane=construct_point, XSize=number_slider_2, YSize=number_slider_2, Radius=0)  # -> Rectangle, Length
unit_z = UnitZ(Factor=number_slider_2)
ghpython_script = GhPythonScript(x=number_slider)  # -> out, a
# ---------- ghpython_script: Python ----------
for input in ghenv.Component.Params.Input:
    for source in input.Sources:
        a = str(source.InstanceGuid)
# ---------- end ghpython_script ----------
expression = Expression(x=taper, y="6", Expression="x / y")
move = Move(Geometry=rectangle.Rectangle, Motion=unit_z)  # -> Geometry, Transform
panel = Panel(ghpython_script.a)
area = Area(Geometry=move.Geometry)  # -> Area, Centroid
scale = Scale(Geometry=move.Geometry, Center=area.Centroid, Factor=expression)  # -> Geometry, Transform
radians = Radians(Degrees=expr("1.0 - x * 5", Slider(9, range=0..10)))
rotate = Rotate(Geometry=scale.Geometry, Angle=radians, Plane=area.Centroid)  # -> Geometry, Transform
loft = Loft(
    Curves=[rotate.Geometry, rectangle.Rectangle],
    Options={Adjust=False, Closed=False, LoftEnds=0, LoftSimp=0, LoftType=0, Rebuild=10, Refit=0.01})
cap_holes = CapHoles(Brep=loft)
ghpython_script_2 = GhPythonScript(x=cap_holes)  # -> out, a; same code as ghpython_script
panel_2 = Panel(ghpython_script_2.a)
