# Grasshopper definition GridTower.gh (Grasshopper 1.0.7)

colour_picker = ColourPicker(PickedColour=RGB(255, 255, 255))
ghpython_script = GhPythonScript(size=Slider(6.16, range=0..100), n=Slider(3, range=0..10))  # -> out, tower; inputs size: Int32, n: Int32
# ---------- ghpython_script: Python ----------
import rhinoscriptsyntax as rs
import Rhino.Geometry as rg
import random as r

def grid_tow(size, n):
    plane = rg.Plane.WorldXY
    r1 = rs.AddRectangle(plane, size, size)
    
    recs = []
    for i in range(n):
        for j in range(n):
            r2 = rs.CopyObject(r1, [i*size, j*size, 0])
            recs.append(r2)
    
    es = []
    for i in range(len(recs)):
        e = rs.ExtrudeCurveStraight(recs[i], [0,0,0], [0,0,r.randint(20, 150)])
        es.append(e)
        rs.CapPlanarHoles(es[i])
        
    
    return es

tower = grid_tow(size, n)
# ---------- end ghpython_script ----------
custom_preview = CustomPreview(Geometry=ghpython_script.tower, Material=colour_picker)
