# Grasshopper definition no_jam.gh (Grasshopper 1.0.7)

ghpython_script = GhPythonScript(seed=Slider(84, range=0..100), iteration=Slider(500, range=0..500))  # -> out, circulation; inputs seed: Int32, iteration: Int32
# ---------- ghpython_script: Python ----------
import math
import random
import Rhino.Geometry as rg
import Rhino.RhinoDoc as rc
import rhinoscriptsyntax as rs
import ghpythonlib.components as gh

random.seed(seed)
generation = 0
sub_generation = 0
circulation = []

while generation < iteration:
    # start point
    if generation == 0:
        location = rg.Point3d(0,0,0)
        circulation.append(location)
        
    action = random.randint(0,3)
    if action == 0:
        location = location + rg.Point3d(-1,0,0)
    elif action == 1:
        location = location + rg.Point3d(0,1,0)
    elif action == 2:
        location = location + rg.Point3d(1,0,0)
    elif action == 3:
        location = location + rg.Point3d(0,-1,0)
    
    if location in circulation:
        if sub_generation <= 100:
            location = circulation[-1]
            sub_generation += 1
            continue
        else:
            sub_generation = 0
            
    
    circulation.append(location)
    
    generation += 1
# ---------- end ghpython_script ----------
rectangle = Rectangle(Plane=ghpython_script.circulation, XSize=" -0.5 To 0.5", YSize=" -0.5 To 0.5", Radius=0)  # -> Rectangle, Length
polyline = PolyLine(Vertices=ghpython_script.circulation, Closed=False)
