# Grasshopper definition CruvedSrf.gh (Grasshopper 1.0.7)

number_slider = Slider(23, range=0..100)
number_slider_2 = Slider(8, range=1..10)
negative = Negative(Value=number_slider)
ghpython_script = GhPythonScript(rec_size=number_slider, UVcount=number_slider_2)  # -> out, a, b, c; inputs rec_size: Int32, UVcount: Int32
# ---------- ghpython_script: Python ----------
import rhinoscriptsyntax as rs
import Rhino.Geometry as rg
import random as r


rec = rs.AddRectangle([-rec_size,-rec_size,0], rec_size*2, rec_size*2)
div = rec_size / UVcount * 2

# comprehension syntax
# pts = [rs.AddPoint((i*div-rec_size) ,(j*div-rec_size) ,0) for i in range(UVcount+1) for j in range(UVcount+1)]

pts = []
for i in range(UVcount+1):
    for j in range(UVcount+1):
        p = rs.AddPoint((i*div-rec_size) ,(j*div-rec_size) ,0)
        pts.append(p)

rpts = []
for i in range(len(pts)):
    rp = rs.MoveObject(pts[i], [0,0,r.randrange(10, 23)])
    rpts.append(rp)

a = pts
b = rec
c = rpts
# ---------- end ghpython_script ----------
construct_domain = ConstructDomain(DomainStart=negative, DomainEnd=number_slider)
number_slider_3 = Slider(10, range=0..10)
rectangle = Rectangle(Plane=PlaneXY(0, 0, 0), XSize=construct_domain, YSize=construct_domain, Radius=0)  # -> Rectangle, Length
addition = Addition(A=number_slider_2, B="1")
surface_from_points = SurfaceFromPoints(Points=ghpython_script.c, UCount=addition, Interpolate=False)
divide_surface = DivideSurface(Surface=rectangle.Rectangle, UCount=number_slider_3, VCount=number_slider_3)  # -> flatten(Points), Normals, Parameters
construct_domain_2 = ConstructDomain(DomainStart=Slider(10, range=0..10), DomainEnd=Slider(23, range=0..100))
list_length = ListLength(List=divide_surface.Points)
random = Random(Range=construct_domain_2, Number=list_length, Seed=2)
amplitude = Amplitude(Vector=divide_surface.Normals, Amplitude=random)
move = Move(Geometry=divide_surface.Points, Motion=amplitude)  # -> Geometry, Transform
addition_2 = Addition(A=number_slider_3, B="1")
colour_picker = ColourPicker(PickedColour=RGB(121, 217, 191))
surface_from_points_2 = SurfaceFromPoints(Points=move.Geometry, UCount=addition_2, Interpolate=Toggle(True))
custom_preview = CustomPreview(Geometry=surface_from_points_2, Material=colour_picker)
