# Grasshopper definition DivideSrf.gh (Grasshopper 1.0.7)

number_slider = Slider(29, range=0..100)
negative = Negative(Value=number_slider)
construct_domain = ConstructDomain(DomainStart=negative, DomainEnd=number_slider)
number_slider_2 = Slider(5, range=0..10)
plane_surface = PlaneSurface(Plane=PlaneXY(0, 0, 0), XSize=construct_domain, YSize=construct_domain)
divide_domain² = DivideDomain²(Domain=plane_surface, UCount=number_slider_2, VCount=number_slider_2)
surface = Surface(plane_surface)
isotrim = Isotrim(Surface=surface, Domain=divide_domain²)
