# Grasshopper definition Rotate.gh (Grasshopper 1.0.7)

number_slider = Slider(44, range=0..100)
number_slider_2 = Slider(3, range=0..10)
square = Square(Plane=PlaneXY(0, 0, 0), Size=number_slider, ExtentX=number_slider_2, ExtentY=number_slider_2)  # -> Cells, Points
multiplication = Multiplication(A=Slider(114, range=0..1000), B=Slider(5.5, range=0..10))
unit_z = UnitZ(Factor=multiplication)
ghpython_script = GhPythonScript(size=number_slider, grid=number_slider_2, height=multiplication, angle=Slider(90, range=0..90))  # -> out, rec, recs1, recs2, loft, a; inputs size: Int32, grid: Int32, height: Int32, angle: Int32
# ---------- ghpython_script: Python ----------
import rhinoscriptsyntax as rs
import Rhino.Geometry as rg
import random as r

plane = rg.Plane.WorldXY
rec = rs.AddRectangle(plane, size, size)
recs1 = []
for i in range(grid):
    for j in range(grid):
        rc = rs.CopyObject(rec, [i*size, j*size, 0])
        recs1.append(rc)

recs2 = []
for i in range(len(recs1)):
#    rc = rs.CopyObject(recs1[i], [0, 0, r.randint(height/2, height)])
    rc = rs.CopyObject(recs1[i], [0, 0, height])
    recs2.append(rc)

centroid = rs.CurveAreaCentroid(recs1[4])
rs.RotateObjects(recs2, centroid[0], angle)

recs3 = []
for i in range(len(recs1)):          
    merge = [recs1[i]] + [recs2[i]]  # rectangle grouping for loft
    recs3.append(merge)

loft = []
for i in range(len(recs1)):
    lo = rs.AddLoftSrf(recs3[i])     # object GUID ▼
    rs.CapPlanarHoles(lo)
    loft.append(rs.coercebrep(lo))   # Translate Geometry.Brep object
# ---------- end ghpython_script ----------
curve = Curve(flatten(square.Cells))
extrude = Extrude(Base=curve, Direction=unit_z)
