# Grasshopper definition Box.gh (Grasshopper 1.0.7)

number_slider = Slider(39, range=0..100)
ghpython_script = GhPythonScript(x_num=number_slider, y_num=number_slider)  # -> out, a, b; inputs x_num: Int32, y_num: Int32
# ---------- ghpython_script: Python ----------
import rhinoscriptsyntax as rs
import Rhino.Geometry as rg
import random

pts = []


for x in range(x_num):
    for y in range(y_num):
        p = rs.AddPoint(x*10, y*10, 0)
        p = rs.PointCoordinates(p)
        pts.append(p)


box_list = []
box_size = 0.8
for x in range(x_num):
    for y in range(y_num):
#        box_size = (x/x_num + y/y_num) / 3
        box = rg.Box(rg.Plane.WorldXY, rg.Interval(x, x+box_size), rg.Interval(y, y+box_size), rg.Interval(0, random.randrange(1, 7)))
        box_list.append(box)
    
b = box_list
# ---------- end ghpython_script ----------
ghpython_script_2 = GhPythonScript(seed=Slider(500, range=0..1000))  # -> out, a
# ---------- ghpython_script_2: Python ----------
import rhinoscriptsyntax as rs
import Rhino.Geometry as rg
import random

random.seed(seed)

x_size = random.randrange(5, 50)
y_size = random.randrange(5, 50)
z_size = random.randrange(5, 50)


box = rg.Box(rg.Plane.WorldXY, rg.Interval(0, x_size), rg.Interval(0, y_size), rg.Interval(0, z_size))
a = box
# ---------- end ghpython_script_2 ----------
