# Grasshopper definition 3dMatrixWall.gh (Grasshopper 1.0.7)

ghpython_script = GhPythonScript(imax=Slider(10, range=0..10), jmax=Slider(2, range=0..10), kmax=Slider(10, range=0..10))  # -> out, ptDict, graft(crvBacks), crvFronts, midPts; inputs imax: Int32, jmax: Int32, kmax: Int32
# ---------- ghpython_script: Python ----------
import ghpythonlib.components as gh
import random as rnd

ptDict = {}
crvBacks = []
crvFronts = []
midPts= []

def midPt(pt01, pt02):
    midPt = gh.ConstructPoint((pt01[0] + pt02[0]) / 2,(pt01[1] + pt02[1]) / 2,(pt01[2] + pt02[2]) / 2)
    midPts.append(midPt)
    return midPt

def pointMatrix(imax, jmax, kmax):
    for i in range(imax):
        for j in range(jmax):
            for k in range(kmax):
                if j == 0:
                    x = i*5 + (rnd.random()*5)
                    y = j*5
                    z = k*5 + (rnd.random()*5)
                    point = gh.ConstructPoint(x, y, z)
                    ptDict[(i,j,k)] = point
                else:
                    x = i*5
                    y = j*5
                    z = k*5
                    point = gh.ConstructPoint(x, y, z)
                    ptDict[(i,j,k)] = point
                    
    for i in range(imax):
        for j in range(jmax):
            for k in range(kmax):
                if i>0 and j>0 and k>0:
                    crvBack = gh.PolyLine((ptDict[(i,j,k)], ptDict[(i-1,j,k)],
                    ptDict[(i-1,j,k-1)], ptDict[(i,j,k-1)], ptDict[(i,j,k)]), 0)
                    crvBacks.append(crvBack)
                    crvFront = gh.PolyLine((ptDict[(i,j-1,k)], ptDict[(i-1,j-1,k)],
                    ptDict[(i-1,j-1,k-1)], ptDict[(i,j-1,k-1)], ptDict[(i,j-1,k)]), 0)
                    crvFronts.append(crvFront)
                    midPt(ptDict[(i-1,j-1,k-1)], ptDict[(i,j-1,k)])


pointMatrix(imax, jmax, kmax)
# ---------- end ghpython_script ----------
scale = Scale(Geometry=ghpython_script.crvFronts, Center=ghpython_script.midPts, Factor=Slider(0.499, range=0.001..1))  # -> graft(Geometry), Transform
loft = Loft(
    Curves=[scale.Geometry, ghpython_script.crvBacks],
    Options={Adjust=False, Closed=False, LoftEnds=0, LoftSimp=0, LoftType=0, Rebuild=10, Refit=0.01})
colour_picker = ColourPicker(PickedColour=RGB(207, 207, 207))
custom_preview = CustomPreview(Geometry=loft, Material=colour_picker)
