# Grasshopper definition AttractorStep.gh (Grasshopper 1.0.7)

number_slider = Slider(15, range=0..20)
point = Point(Point(7.634073495, 3.111623041, 5.503766905))
ghpython_script = GhPythonScript(x_count=number_slider, y_count=number_slider, attractor=point)  # -> out, grid_step; inputs x_count: Int32, y_count: Int32, attractor: Point3d
# ---------- ghpython_script: Python ----------
import Rhino.Geometry as rg
import ghpythonlib.components as gh

interval = rg.Interval(-0.5, 0.5)

grid_step = []
for x in range(x_count):
    for y in range(y_count):
        origin = rg.Point3d(x, y, 0)
        cell_crv = gh.Rectangle(origin, interval, interval, 0).rectangle
        cell_centroid = cell_crv.Center
        
        distance_to_attractor = cell_centroid.DistanceTo(attractor)
        step = gh.Extrude(cell_crv, rg.Point3d(0, 0, distance_to_attractor))
        capped_step = gh.CapHoles(step)
        
        grid_step.append(capped_step)
# ---------- end ghpython_script ----------
custom_preview = CustomPreview(Geometry=ghpython_script.grid_step, Material=ColourSwatch(SwatchColor=RGB(255, 255, 255)))
