# Grasshopper definition Dom-InoSystem.gh (Grasshopper 1.0.7)

number_slider = Slider(52, range=40..60)
colour_picker = ColourPicker(PickedColour=RGB(255, 255, 255))
ghpython_script = GhPythonScript(slabX=number_slider, slabY=number_slider, floor=Slider(2, range=2..7))  # -> out, columns, columnsBase, slab, slbs, cols, foundation, steps, stps; inputs floor: Int32
# ---------- ghpython_script: Python ----------
import Rhino.Geometry as rg
import rhinoscriptsyntax as rs
import ghpythonlib.components as gh
import math

I = rg.Interval
slabZ = 1.5

slab = rg.Box(rg.Plane.WorldXY, I(0, slabX), I(0, slabY/2), I(0, slabZ))
slabSrf = gh.DeconstructBrep(slab)[0][5]
columnsBase = gh.DivideSurface(slabSrf, 11, 5)[0]
columnsIdx = [7, 10, 31, 34, 55, 58]
ln = rs.AddCurve([columnsBase[59], columnsBase[56], columnsBase[68]], 1)
trimSrf = rs.ExtrudeCurve(ln, rs.AddLine([0,0,0],[0,0,-slabZ]))

slab = rs.TrimBrep(rs.MoveObjects(slab, [0,0,0])[0], trimSrf)

columns = []
foundation = []
for i in columnsIdx:
    column = gh.DomainBox(columnsBase[i], 1,1,15-slabZ)
    rs.MoveObject(column, [-0.5,-0.5,0])
    columns.append(column)
    
    found = gh.DomainBox(columnsBase[i], 5,5,-3-slabZ)
    rs.MoveObject(found, [-2.5,-2.5,-slabZ])
    foundation.append(found)


cols = []
slbs = []
for i in range(len(columns)):
    for j in range(1, floor):
        cols.append(rs.CopyObject(columns[i], [0,0,(j-1)*15]))
        slbs.append(rs.CopyObject(slab, [0,0,j*15]))
        

stepDis = rs.Distance(columnsBase[62], columnsBase[68])
steps = []
columnsBase[58][2] = 9.5
for i in range(8):        
    step1 = gh.DomainBox(columnsBase[68], -stepDis,stepDis/2,1)  
    step2 = gh.DomainBox(columnsBase[58], stepDis,-stepDis/2,1)    
    if i == 7:
        step1 = gh.DomainBox(columnsBase[68], -stepDis*2,stepDis*1.3,1)
    steps.append(rs.CopyObject(step1, [0,i*stepDis/3.5,i*1]))    
    steps.append(rs.CopyObject(step2, [0,-i*stepDis/3.5,i*1]))
    
    if len(steps) >= 15:
        steps.pop(15)


stps = []
for i in range(len(steps)):
    for j in range(1, floor):  
        stps.append(rs.CopyObject(steps[i], [0,0,(j-1)*15]))
# ---------- end ghpython_script ----------
custom_preview = CustomPreview(
    Geometry=[ghpython_script.columns, ghpython_script.slbs, ghpython_script.cols, ghpython_script.foundation, ghpython_script.slab, ghpython_script.steps, ghpython_script.stps],
    Material=colour_picker)
