# Grasshopper definition MatrixStep.gh (Grasshopper 1.0.7)

ghpython_script = GhPythonScript(maxtrix_count=Slider(9, range=5..20), height=Slider(0.58, range=0.01..1), scale=Slider(5.43, range=1..10))  # -> out, matrix_step; inputs maxtrix_count: Int32
# ---------- ghpython_script: Python ----------
import Rhino.Geometry as rg
import Rhino.RhinoDoc as rc
import rhinoscriptsyntax as rs
import ghpythonlib.components as gh

matrix_step = []

for i in range(maxtrix_count):
    z = i * height
    
    for j in range(maxtrix_count):
        step_base = rg.Point3d(i*scale, j*scale, z)
        step_rec = gh.Rectangle(step_base, scale, scale, 0).rectangle
        step_srf = gh.BoundarySurfaces(step_rec)
        step_vec = rg.Point3d(0, 0, -z)
        
        step = gh.Extrude(step_srf, step_vec)
        
        z = z + height
        
        matrix_step.append(step)
# ---------- end ghpython_script ----------
move = Move(Geometry=ghpython_script.matrix_step, Motion=Vector(223, 0, 0))  # -> Geometry, Transform
custom_preview = CustomPreview(Geometry=move.Geometry, Material=ColourSwatch(SwatchColor=RGB(199, 199, 199)))
