# Grasshopper definition RecursiveStair.gh (Grasshopper 1.0.7)

x = Slider(575, range=0..1000)
y = Slider(239, range=0..1000)
z = Slider(102, range=0..1000)
z_2 = Slider(31, range=0..1000)
angle = Slider(26.34, range=0..100)
iteration = Slider(4, range=0..10)
colour_picker = ColourPicker(PickedColour=RGB(255, 255, 255))
ghpython_script = GhPythonScript(x=x, y=y, z=z, steps=z_2, angle=angle, iteration=iteration)  # -> out, a; inputs x: Int32, y: Int32, z: Int32, steps: Int32, iteration: Int32
# ---------- ghpython_script: Python ----------
import rhinoscriptsyntax as rs
import Rhino.Geometry as geo
import scriptcontext as sc

stepList = []

for i in range(steps):
    if i == steps-1:
        step = rs.AddRectangle(rs.WorldXYPlane(), x, y)
    else:
        step = rs.AddRectangle(rs.WorldXYPlane(), x, y)
    step = rs.AddPlanarSrf(step)
    step = rs.ExtrudeSurface(step, rs.AddLine([0,0,0], [0,0,z]))
    step = rs.RotateObject(step,[0,0,0],angle*i)
    stepList.append(rs.CopyObject(step, [0,0,z*i]))

a = stepList
# ---------- end ghpython_script ----------
custom_preview = CustomPreview(Geometry=ghpython_script.a, Material=colour_picker)
