# Grasshopper definition WaveCircle.gh (Grasshopper 1.0.7)

radius = Slider(15.45, range=0..100)
divide_count = Slider(24, range=3..100)
offset_distance = Slider(7, range=0..10)
ghpython_script = GhPythonScript(radius=radius, divide_count=divide_count)  # -> out, circle, divide_pts; inputs divide_count: Int32
# ---------- ghpython_script: Python ----------
import Rhino.Geometry as rg
import rhinoscriptsyntax as rs
import ghpythonlib.components as gh

origin = rg.Point3d(150,0,0)
circle = rg.Circle(origin, radius)
divide_pts = gh.DivideCurve(circle, divide_count, False).points

moved_divide_pts = []
for i, p in enumerate(divide_pts):
    if i % 2 == 0:
        rs.MoveObject(p, [0,0,radius/5])
# ---------- end ghpython_script ----------
interpolate = Interpolate(Vertices=ghpython_script.divide_pts, Degree=3, Periodic=True, KnotStyle=1)  # -> Curve, Length, Domain
offset_curve = OffsetCurve(Curve=interpolate.Curve, Distance=offset_distance, Plane=PlaneXY(0, 0, 0), Corners=1)
ruled_surface = RuledSurface(CurveA=interpolate.Curve, CurveB=offset_curve)
