# Grasshopper definition WaveFlowBox.gh (Grasshopper 1.0.7)

colour_picker = ColourPicker(PickedColour=RGB(255, 255, 255))
ghpython_script = GhPythonScript(
    pNum=Slider(10, range=0..100),
    minZ=Slider(50, range=1..50),
    maxZ=Slider(50, range=1..50),
    scale=Slider(15, range=0..100))  # -> out, srf, box; inputs pNum: Int32
# ---------- ghpython_script: Python ----------
import rhinoscriptsyntax as rs
import Rhino.Geometry as rg
import ghpythonlib.components as gh
import random as r
import Rhino

pts = []
for i in range(pNum+1):
    for j in range(pNum+1):
        pt = rs.AddPoint(i*scale, j*scale, r.randint(minZ, maxZ))
        pt = rs.PointCoordinates(pt)
        pts.append(pt)

srf = gh.SurfaceFromPoints(pts, pNum+1, False)
box = gh.DomainBox(rg.Plane.WorldXY, pNum*scale, pNum*scale, pNum*scale)
box = rs.MoveObject(box, [0,0,0])

rs.TrimBrep(box, srf)
# ---------- end ghpython_script ----------
custom_preview = CustomPreview(Geometry=[ghpython_script.box, ghpython_script.srf], Material=colour_picker)
