# Grasshopper definition WorkingWithAttractors.gh (Grasshopper 1.0.7)

point = Point(Point(-2.861978731, 33.48277105, 9.247198655))
ghpython_script = GhPythonScript(cells=Slider(30, range=0..30), attractor=point)  # -> out, circles, hexagon_cells, hexagon_points, vectors; inputs attractor: Point3d
# ---------- ghpython_script: Python ----------
import random
import Rhino.Geometry as rg
import ghpythonlib.components as gh

O = 1
PLANE = rg.Plane.WorldXY

hexagon_cells, hexagon_points = gh.Hexagonal(plane=PLANE,
                                             size=O,
                                             extent_x=cells,
                                             extent_y=cells-3)

circles = []
vectors = []
for hexagon_point in hexagon_points:
    normal = attractor - hexagon_point
    circle = gh.CircleCNR(center=hexagon_point, normal=normal, radius=O/1.2)
    circle_surface = gh.BoundarySurfaces(edges=circle)
    
    circles.append(circle_surface)
    vectors.append(normal)
# ---------- end ghpython_script ----------
vector_display = VectorDisplay(Anchor=ghpython_script.hexagon_points, Vector=ghpython_script.vectors)
custom_preview = CustomPreview(Geometry=ghpython_script.hexagon_cells, Material=ColourSwatch(SwatchColor=RGB(105, 105, 105)))
custom_preview_2 = CustomPreview(Geometry=ghpython_script.circles, Material=ColourSwatch(SwatchColor=RGB(0, 0, 0)))
