# Grasshopper definition generativeDesign.gh (Grasshopper 1.0.7)

number_slider = Slider(3, range=0..10)
number_slider_2 = Slider(23, range=0..100)
number_slider_3 = Slider(4.5, range=0..10)
merge = Merge(
    Data1=Slider(54, range=0..110),
    Data2=Slider(50, range=0..110),
    Data3=Slider(16, range=0..110),
    Data4=Slider(73, range=0..110),
    Data6=Slider(16, range=0..110),
    Data7=Slider(110, range=0..110),
    Data8=Slider(110, range=0..110),
    Data9=Slider(70, range=0..110))
ghpython_script = GhPythonScript(massHeight=number_slider_2)  # -> out, mass1, mass2, mass1Crv, mass2Crv; inputs massHeight: Int32
# ---------- ghpython_script: Python ----------
import Rhino.Geometry as rg
import rhinoscriptsyntax as rs
import ghpythonlib.components as gh

x = massHeight
path = rs.AddLine(rs.AddPoint(0,0,0), rs.AddPoint(0,0,x*2))

mass1Crv = rs.AddRectangle([x*4,0,0], x*3, x*3)
mass1 = rs.ExtrudeCurve(mass1Crv, path)
rs.CapPlanarHoles(mass1)

mass2Crv = rs.AddRectangle([0,x*4,0], x*3, x*3)
#mass2 = rs.ExtrudeCurve(mass2Crv, path)
#rs.CapPlanarHoles(mass2)
# ---------- end ghpython_script ----------
square = Square(Plane=PlaneXY(0, 0, 0), Size=number_slider_2, ExtentX=number_slider, ExtentY=number_slider)  # -> Cells, Points
sort_list = SortList(Keys=merge)  # -> reverse(Keys), ValuesValuesA
split_list = SplitList(List=merge, Index=Slider(4, range=0..10))  # -> ListA, ListB
list_item = ListItem(List=sort_list.Keys, Index=0, Wrap=True)
merge_2 = Merge(Data1=flatten(split_list.ListA), Data2=flatten(list_item), Data3=flatten(split_list.ListB))
multiplication = Multiplication(A=number_slider_3, B=merge_2)
unit_z = UnitZ(Factor=multiplication)

# ---- group: Tower
curve = Curve(flatten(square.Cells))
vector = Vector(unit_z)
extrude = Extrude(Base=curve, Direction=vector)

# ----
panel = Panel(merge_2)
cap_holes = CapHoles(Brep=extrude)

# ---- group: Area
mass_addition = MassAddition(Input=merge_2)  # -> Result, PartialResults
number = Number(number_slider_2)
multiplication_2 = Multiplication(A=number, B=number, C=mass_addition.Result)

# ----
geometry = Geometry(cap_holes)
number_2 = Number(number_slider_3)
contour = Contour(Shape=geometry, Point=Point(0, 0, 0), Direction=Vector(0, 0, 1), Distance=number_2)  # disabled
panel_2 = Panel(multiplication_2)
curve_2 = Curve(contour)

# ---- group: Sun Vector
sphere = Sphere(Base=PlaneXY(0, 0, 0), Radius=Slider(550, range=0..1000))
brep_plane = BrepPlane(Brep=sphere, Plane=PlaneXY(0, 0, 0))  # -> Curves, Points
surface_split = SurfaceSplit(Surface=sphere, Curves=brep_plane.Curves)
construct_point = ConstructPoint(XCoordinate=Slider(0.6, range=0..1), YCoordinate=Slider(0.9, range=0.5..1), ZCoordinate=0)
list_item_2 = ListItem(List=surface_split, Index=0, Wrap=True)
iso_curve = IsoCurve(Surface=reparameterize(list_item_2), UVPoint=construct_point)  # -> UIsocurve, VIsocurve
evaluate_surface = EvaluateSurface(Surface=reparameterize(list_item_2), Point=construct_point)  # -> Point, Normal, UDirection, VDirection, Frame
point = Point(evaluate_surface.Point)
vector_2 = Vector(evaluate_surface.Normal)
reverse = Reverse(Vector=vector_2)
amplitude = Amplitude(Vector=reverse, Amplitude=Slider(176, range=0..1000))
vector_display = VectorDisplay(Anchor=point, Vector=amplitude)

# ----
area = Area(Geometry=curve_2)  # -> Area, Centroid
mass_addition_2 = MassAddition(Input=flatten(area.Area))  # -> Result, PartialResults
panel_3 = Panel(mass_addition_2.Result)

# ---- group: sun analysis / MASS1
par = Curve(ghpython_script.mass1Crv)

# ---- group: sun analysis
vector_3 = Vector(amplitude)
mesh = Mesh(geometry)
mesh_shadow = MeshShadow(Mesh=mesh, Light=vector_3, Plane=PlaneXY(0, 0, 0))
region_union = RegionUnion(Curves=flatten(mesh_shadow))
park = Curve(ghpython_script.mass2Crv)

# ---- group: sun analysis / SHADOW
curve_3 = Curve(region_union)

# ---- group: sun analysis (continued)
area_2 = Area(Geometry=curve_3)  # -> Area, Centroid
region_intersection = RegionIntersection(CurvesA=curve_3, CurvesB=par)
region_intersection_2 = RegionIntersection(CurvesA=curve_3, CurvesB=park)
area_3 = Area(Geometry=region_intersection)  # -> Area, Centroid
area_4 = Area(Geometry=region_intersection_2)  # -> Area, Centroid
null_item = NullItem(Item=region_intersection)  # -> NullFlags, InvalidFlags, Description
null_item_2 = NullItem(Item=region_intersection_2)  # -> NullFlags, InvalidFlags, Description
weave = Weave(Pattern=null_item.NullFlags, Stream0=area_3.Area, Stream1="0", NullGaps=False)
weave_2 = Weave(Pattern=null_item_2.NullFlags, Stream0=area_4.Area, Stream1="0", NullGaps=False)
park_shadow_area = Panel(weave_2)
building_shadow_area = Panel(area_2.Area)
mass_shadow_area = Panel(weave)
