# Grasshopper definition shadowAnalysis.gh (Grasshopper 1.0.7)

number_slider = Slider(23, range=0..100)
merge = Merge(
    Data1=Slider(54, range=0..110),
    Data2=Slider(50, range=0..110),
    Data3=Slider(46, range=0..110),
    Data4=Slider(73, range=0..110),
    Data5=Slider(0, range=-1..0),
    Data6=Slider(31, range=0..110),
    Data7=Slider(110, range=0..110),
    Data8=Slider(110, range=0..110),
    Data9=Slider(70, range=0..110))

# ---- group: base
ghpython_script = GhPythonScript(recSize=number_slider, recNum=Slider(3, range=0..10), heightList=merge, floorHeight=Slider(4.5, range=0..10))  # -> out, heightList, bdgs, bdgsArea, contour; inputs recSize: Int32, recNum: Int32, heightList: list
# ---------- ghpython_script: Python ----------
import Rhino.Geometry as rg
import rhinoscriptsyntax as rs
import ghpythonlib.components as gh

baseRec = []
for i in range(recNum):
    for j in range(recNum):
        base = rs.AddRectangle([i*recSize,j*recSize,0], recSize, recSize)
        baseRec.append(base)


bdgs = []
heightList = [i*floorHeight for i in heightList]
for i in range(len(baseRec)):
    path = rs.AddLine(rs.AddPoint(0,0,0), rs.AddPoint(0,0,heightList[i]))
    if heightList[i] == 0:
        path = rs.AddLine(rs.AddPoint(0,0,0), rs.AddPoint(0,0,max(heightList)))
    bldg = rs.coercebrep(rs.ExtrudeCurve(baseRec[i], path))
    rs.CapPlanarHoles(bldg)
    bdgs.append(bldg)

bdgs = gh.CapHoles(bdgs)


contour = []
basePoint = rs.coerce3dpoint(rs.AddPoint(0,0,0))
endPoint = rs.coerce3dpoint(rs.AddPoint(0,0,max(heightList)))
for i in range(len(bdgs)):
    contourCrv = rg.Brep.CreateContourCurves(bdgs[i], basePoint, endPoint, floorHeight)
    contour.append(contourCrv)


bdgsArea = 0
for i in range(len(contour)):
    bdgsArea += len(contour[i])*23**2 - 23**2
# ---------- end ghpython_script ----------

# ----
ghpython_script_2 = GhPythonScript(rad=Slider(550, range=0..1000), u=Slider(0.6, range=0..1), v=Slider(0.9, range=0.5..1))  # -> out, sunPath, sunPt, sun, ground, isoCrv, a
# ---------- ghpython_script_2: Python ----------
import Rhino.Geometry as rg
import rhinoscriptsyntax as rs
import ghpythonlib.components as gh
import Grasshopper.Kernel.Types as gt

plane = [0,0,0]
sunPath = rs.coercebrep(rs.AddSphere(plane, rad))
ground = rs.coercecurve(rs.AddCircle(plane, rad))
ground = gh.BoundarySurfaces(ground)
sunPath = rs.coercesurface(gh.SplitBrep(sunPath, ground)[0])

dom = rg.Interval(0.00, 1.00)
sunPath.SetDomain(0, dom)
sunPath.SetDomain(1, dom)
sunPt = rs.EvaluateSurface(sunPath, u, v)
sun = rs.AddSphere(sunPt, 35)

print(gt.GH_Surface(sunPath))
print(rs.coercesurface(sunPath))

crvPt = gh.ConstructPoint(u,v,0)
isoCrv = gh.IsoCurve(gt.GH_Surface(sunPath), crvPt)
isoCrv = rs.MoveObjects(isoCrv, [0,0,0])
# ---------- end ghpython_script_2 ----------

# ---- group: surround mass
ghpython_script_3 = GhPythonScript(massHeight=number_slider)  # -> out, mass1, mass2, mass1Crv, mass2Crv; inputs massHeight: Int32
# ---------- ghpython_script_3: Python ----------
import Rhino.Geometry as rg
import rhinoscriptsyntax as rs
import ghpythonlib.components as gh

x = massHeight
path = rs.AddLine(rs.AddPoint(0,0,0), rs.AddPoint(0,0,x*2))

mass1Crv = rs.AddRectangle([x*4,0,0], x*3, x*3)
mass1 = rs.ExtrudeCurve(mass1Crv, path)
rs.CapPlanarHoles(mass1)

mass2Crv = rs.AddRectangle([0,x*4,0], x*3, x*3)
#mass2 = rs.ExtrudeCurve(mass2Crv, path)
#rs.CapPlanarHoles(mass2)
# ---------- end ghpython_script_3 ----------

# ----
geometry = Geometry([ghpython_script_2.isoCrv, ghpython_script_2.a])
brep = Brep(ghpython_script_2.sun)
surface = Surface(ghpython_script_2.sunPath)
point = Point(ghpython_script_2.sunPt)
building_floor_area = Panel(ghpython_script.bdgsArea)
building_height = Panel(ghpython_script.heightList)
point_2 = Point(Point(0, 0, 0))
vector_2pt = Vector2Pt(PointA=point, PointB=point_2, Unitize=False)  # -> Vector, Length
amplitude = Amplitude(Vector=vector_2pt.Vector, Amplitude=Slider(280, range=0..1000))
vector_display = VectorDisplay(Anchor=point, Vector=amplitude)
