# Grasshopper definition shadowAnalysis.gh (Grasshopper 1.0.7)

number_slider = Slider(23, range=0..100)

# ---- group: building heights
merge = Merge(
    Data1=graft([Slider(54, range=0..110), Slider(54, range=0..110), Slider(54, range=0..110)]),
    Data2=graft([Slider(85, range=0..110), Slider(13, range=0..110), Slider(13, range=0..110)]),
    Data3=graft([Slider(46, range=0..110), Slider(110, range=0..110), Slider(46, range=0..110)]),
    Data4=graft([Slider(73, range=0..110), Slider(23, range=0..110), Slider(23, range=0..110)]),
    Data5=graft([Slider(0, range=-1..0), Slider(0, range=-1..0), Slider(0, range=-1..0)]),
    Data6=graft([Slider(93, range=0..110), Slider(27, range=0..110), Slider(27, range=0..110)]),
    Data7=graft([Slider(110, range=0..110), Slider(33, range=0..110), Slider(33, range=0..110)]),
    Data8=graft([Slider(110, range=0..110), Slider(58, range=0..110), Slider(110, range=0..110)]),
    Data9=graft([Slider(70, range=0..110), Slider(70, range=0..110), Slider(70, range=0..110)]))

# ---- group: surround mass
ghpython_script = GhPythonScript(massHeight=number_slider)  # -> out, mass1, mass2, mass1Crv, mass2Crv; inputs massHeight: Int32
# ---------- ghpython_script: Python ----------
import Rhino.Geometry as rg
import rhinoscriptsyntax as rs
import ghpythonlib.components as gh

x = massHeight
path = rs.AddLine(rs.AddPoint(0,0,0), rs.AddPoint(0,0,x*2))

mass1Crv = rs.AddRectangle([x*4,0,0], x*3, x*3)
mass1 = rs.ExtrudeCurve(mass1Crv, path)
rs.CapPlanarHoles(mass1)

mass2Crv = rs.AddRectangle([0,x*4,0], x*5, x*5)
#mass2 = rs.ExtrudeCurve(mass2Crv, path)
#rs.CapPlanarHoles(mass2)
# ---------- end ghpython_script ----------

# ---- group: base
ghpython_script_2 = GhPythonScript(recSize=number_slider, recNum=Slider(3, range=0..10), heightList=simplify(merge), floorHeight=Slider(4.5, range=0..10))  # -> out, baseRec, simplify(heightList), bdgs, bdgsArea, contour; inputs recSize: Int32, recNum: Int32, heightList: list
# ---------- ghpython_script_2: Python ----------
import Rhino.Geometry as rg
import rhinoscriptsyntax as rs
import ghpythonlib.components as gh

baseRec = []
for i in range(recNum):
    for j in range(recNum):
        base = rs.AddRectangle([i*recSize,j*recSize,0], recSize, recSize)
        baseRec.append(base)


bdgs = []
heightList = [i*floorHeight for i in heightList]
for i in range(len(baseRec)):
    path = rs.AddLine(rs.AddPoint(0,0,0), rs.AddPoint(0,0,heightList[i]))
    if heightList[i] == 0:
        path = rs.AddLine(rs.AddPoint(0,0,0), rs.AddPoint(0,0,max(heightList)))
    bldg = rs.coercebrep(rs.ExtrudeCurve(baseRec[i], path))
    rs.CapPlanarHoles(bldg)
    bdgs.append(bldg)

bdgs = gh.CapHoles(bdgs)


contour = []
basePoint = rs.coerce3dpoint(rs.AddPoint(0,0,0))
endPoint = rs.coerce3dpoint(rs.AddPoint(0,0,max(heightList)))
for i in range(len(bdgs)):
    contourCrv = rg.Brep.CreateContourCurves(bdgs[i], basePoint, endPoint, floorHeight)
    contour.append(contourCrv)


bdgsArea = 0
for i in range(len(contour)):
    bdgsArea += len(contour[i])*recSize**2 - recSize**2

heightList = [i/floorHeight for i in heightList]
# ---------- end ghpython_script_2 ----------

# ----
two_buildings_height = Panel(merge)
building_floor_area = Panel(ghpython_script_2.bdgsArea)
building_height = Panel(ghpython_script_2.heightList)

# ---- group: environment
ghpython_script_3 = GhPythonScript(
    baseRec=ghpython_script_2.baseRec,
    rad=Slider(550, range=0..1000),
    u=Slider(0.63, range=0..1),
    v=Slider(0.85, range=0.5..1))  # -> out, sunPath, sunPt, sun, ground, isoCrv, vector; inputs baseRec: list
# ---------- ghpython_script_3: Python ----------
import Rhino.Geometry as rg
import rhinoscriptsyntax as rs
import ghpythonlib.components as gh
import Grasshopper.Kernel.Types as gt

plane = [0,0,0]
sunPath = rs.coercebrep(rs.AddSphere(plane, rad))
ground = rs.coercecurve(rs.AddCircle(plane, rad))
ground = gh.BoundarySurfaces(ground)
sunPath = rs.coercesurface(gh.SplitBrep(sunPath, ground)[0])

dom = rg.Interval(0.00, 1.00)
sunPath.SetDomain(0, dom)
sunPath.SetDomain(1, dom)
sunPt = rs.EvaluateSurface(sunPath, u, v)
sun = rs.AddSphere(sunPt, 35)

#print(gt.GH_Surface(sunPath))
#print(rs.coercesurface(sunPath))

crvPt = gh.ConstructPoint(u,v,0)
isoCrv = gh.IsoCurve(gt.GH_Surface(sunPath), crvPt)
isoCrv = rs.MoveObjects(isoCrv, [0,0,0])

vecPt1 = rs.coerce3dpoint(sunPt)
vecPt2 = rs.CurveAreaCentroid(baseRec[0])[0]
vector = gh.Vector2Pt(vecPt1, vecPt2, False)[0]

#vecDisplay = gh.VectorDisplay(vecPt1, vector)
# ---------- end ghpython_script_3 ----------

# ----
surface = Surface(ghpython_script_3.sunPath)
point = Point(ghpython_script_3.sunPt)
brep = Brep(ghpython_script_3.sun)
geometry = Geometry(ghpython_script_3.isoCrv)
vector = Vector(ghpython_script_3.vector)
amplitude = Amplitude(Vector=vector, Amplitude=Slider(200, range=0..1000))
merge_2 = Merge(Data1=ghpython_script.mass1Crv, Data2=ghpython_script.mass2Crv)
mesh = Mesh(ghpython_script_2.bdgs)
vector_2 = Vector(amplitude)
vector_display = VectorDisplay(Anchor=point, Vector=amplitude)

# ---- group: shadow analysis
ghpython_script_4 = GhPythonScript(bdgs=mesh, vector=vector_2, massCrvs=merge_2)  # -> out, shadow, shadowCrv, shadowArea, mass1ShadArea, greenShadArea, mass1Shad, greenShad; inputs bdgs: list of Mesh, vector: Vector3d, massCrvs: list of Curve
# ---------- ghpython_script_4: Python ----------
import Rhino.Geometry as rg
import rhinoscriptsyntax as rs
import ghpythonlib.components as gh

shadowCrv = gh.MeshShadow(bdgs, vector, rg.Plane.WorldXY)
shadowCrv = gh.RegionUnion(shadowCrv)
shadow = gh.BoundarySurfaces(shadowCrv)
shadow = rs.MoveObject(shadow, [0,0,0])

shadowArea = int(rs.Area(shadow))

try:
    greenShadCrv = rs.MoveObject(gh.RegionIntersection(shadowCrv, massCrvs[1], rg.Plane.WorldXY), [0,0,0])
    greenShad = gh.BoundarySurfaces(rs.coercecurve(greenShadCrv))
    greenShadArea = int(rs.Area(greenShadCrv))
except:
    greenShadArea = 0


try:
    mass1ShadCrv = rs.MoveObject(gh.RegionIntersection(shadowCrv, massCrvs[0], rg.Plane.WorldXY), [0,0,0])
    mass1Shad = gh.BoundarySurfaces(rs.coercecurve(mass1ShadCrv))
    mass1ShadArea = int(rs.Area(mass1ShadCrv))

except:
    mass1ShadArea = 0
# ---------- end ghpython_script_4 ----------

# ----
building_s_shadow_area = Panel(ghpython_script_4.shadowArea)
mass1_s_shadow_area = Panel(ghpython_script_4.mass1ShadArea)
green_s_shadow_area = Panel(ghpython_script_4.greenShadArea)
group = Group(Objects=ghpython_script_2.bdgs)  # -> flatten(Group)
custom_preview = CustomPreview(Geometry=ghpython_script_4.shadowCrv, Material=ColourSwatch(SwatchColor=RGB(87, 87, 87)))
custom_preview_2 = CustomPreview(Geometry=[ghpython_script_4.greenShad, ghpython_script_4.mass1Shad], Material=ColourSwatch(SwatchColor=RGB(255, 0, 0)))

# ---- group: shadowCurve
curve = Curve(flatten(ghpython_script_4.shadowCrv))

# ---- group: Display Matrix
ghpython_script_5 = GhPythonScript(shadowCrv=curve, bdgs=group, size=Slider(300, range=0..1000), Ex=Slider(4, range=0..10), Ey=Slider(4, range=0..10))  # -> out, matrix, palettes, splitMatrix, shadowCrv; inputs shadowCrv: list, bdgs: list, size: Int32, Ex: Int32, Ey: Int32
# ---------- ghpython_script_5: Python ----------
import Rhino.Geometry as rg
import rhinoscriptsyntax as rs
import ghpythonlib.components as gh

#matrix = [rs.AddPoint(i*size,j*size,0) for i in range(Ex) for j in range(Ey)]

matrix = []
for i in range(Ex+1):
    for j in range(Ey+1):
        matrixPoint = rs.AddPoint(i*size, j*size, 0)
        matrix.append(matrixPoint)

palettes = []
for i in range(Ex):
    for j in range(Ey):
        palette = rs.AddRectangle([i*size, j*size, 0] ,size, size)
        palettes.append(palette)

splitIdx = min(len(matrix), len(bdgs))
splitMatrix = matrix[:splitIdx]

shadowCrvs = []
for i in range(splitIdx):
    sCrv = rs.MoveObject(shadowCrv[i], matrix[i])

#alt = []
#for i in range(splitIdx):
#    alt.append(rs.MoveObjects(bdgs[i], matrix[i]))

#a = rs.MoveObjects(bdgs[0], matrix[0])
#b = rs.MoveObjects(bdgs[1], matrix[1])
#c = rs.MoveObjects(bdgs[2], matrix[2])
# ---------- end ghpython_script_5 ----------

# ----
move = Move(Geometry=group, Motion=ghpython_script_5.splitMatrix)  # -> Geometry, Transform
merge_3 = Merge(
    Data1=simplify(building_floor_area),
    Data2=simplify(building_s_shadow_area),
    Data3=simplify(mass1_s_shadow_area),
    Data4=simplify(green_s_shadow_area))
panel = Panel(merge_3)

# ---- group: Annotation Text
ghpython_script_6 = GhPythonScript(text=merge_3)  # -> out, mergeAnnotation; inputs text: list
# ---------- ghpython_script_6: Python ----------
import Rhino.Geometry as rg
import rhinoscriptsyntax as rs
import ghpythonlib.components as gh


annotation = ['bdg floor area :',
             'bdg shadow area :',
             'mass shadow area :',
             'green shadow area :']

for i in range(len(text)):
    text.insert(i*2, annotation[i])

mergeAnnotation = []
for i in range(1, len(text), 2):
    if i == 1:
        annotation = text[:i+1]
    else:
        annotation = text[i-1:i+1]
        
    mergeAnnotation.append(annotation)

mergeAnnotation = [' '.join(i) for i in mergeAnnotation]
mergeAnnotation = '\n'.join(mergeAnnotation)

#print(mergeAnnotation)
# ---------- end ghpython_script_6 ----------

# ----
panel_2 = Panel(ghpython_script_6.mergeAnnotation)
text_tag_3d = TextTag3D(Location=ghpython_script_5.splitMatrix, Text=flatten(panel_2), Size=Slider(15, range=0..100), Justification=1)
