# Grasshopper definition get_surface_normal_vector.gh (Grasshopper 1.0.7)

surface = Surface(reparameterize(<surface referenced from the Rhino model>))
ghpython_script = GhPythonScript(srf=surface, u_num=Slider(11, range=2..100), v_num=Slider(15, range=2..100))  # -> out, evaluate_srf_points, normal_srf_points, normal_srf_lines; inputs srf: Surface, u_num: Int32, v_num: Int32
# ---------- ghpython_script: Python ----------
import Rhino.Geometry as rg

VEC_SCALE = 5
U_DIVIDER = 1 / u_num
V_DIVIDER = 1 / v_num

evaluate_srf_points = []
normal_srf_points = []
normal_srf_lines = []
normal_srf_pipes = []

for u in range(u_num-1):
    u = (u / u_num) + U_DIVIDER
    
    for v in range(v_num-1):
        v = (v / v_num) + V_DIVIDER
    
        evaluate_point = srf.PointAt(u, v)
        evaluate_srf_points.append(evaluate_point)
        
        normal_srf_vector = srf.NormalAt(u, v) * VEC_SCALE
        normal_srf_point = (evaluate_point + normal_srf_vector)
        normal_srf_points.append(normal_srf_point)
        
        normal_srf_line = rg.Line(evaluate_point, normal_srf_point)
        normal_srf_lines.append(normal_srf_line)
# ---------- end ghpython_script ----------
custom_preview = CustomPreview(Geometry=surface, Material=ColourSwatch(SwatchColor=RGB(184, 184, 184)))
vector_display_ex = VectorDisplayEx(
    Point=ghpython_script.evaluate_srf_points,
    Vector=ghpython_script.normal_srf_lines,
    Colour=ColourSwatch(SwatchColor=RGB(0, 0, 0)),
    Width=1)
